# Grasshopper definition structure.gh (Grasshopper 1.0.7)

panel = Panel("""0
10
10
10
10
10
10
10
10
10
10
10""")
panel_2 = Panel("""0
10
15
22
13
10""")
line = Line()
line_2 = Line()
pt = Point()
make_grid = GhPythonScript(
    sp=pt,
    span_x=panel_2,
    span_y=panel,
    xaxis=line,
    yaxis=line_2,
    height=Slider(10, range=0..10),
    core=[Slider(2, range=0..10), Slider(2, range=0..10), Slider(2, range=0..10), Slider(8, range=0..10)])  # -> out, columns, beams_x, beams_y, cores; inputs span_x: list, span_y: list, core: list of Int32
# ---------- make_grid: Python ----------
import rhinoscriptsyntax as rs

from studio2021.functions import make_grid
reload(make_grid)
from studio2021.functions.make_grid import make_grid_structure


columns, beams_x, beams_y, cores = make_grid_structure(sp,
                                                       span_x,
                                                       span_y,
                                                       xaxis,
                                                       yaxis,
                                                       height,
                                                       core)
# ---------- end make_grid ----------
crv = Curve(<curve referenced from the Rhino model>)
crv_2 = Curve(<curve referenced from the Rhino model>)
trim_grid = GhPythonScript(polyline=crv, columns=make_grid.columns, beams_x=make_grid.beams_x, beams_y=make_grid.beams_y, cores=make_grid.cores)  # -> out, columns, beams_x, beams_y, cores; inputs columns: list, beams_x: list, beams_y: list, cores: list
# ---------- trim_grid: Python ----------
import rhinoscriptsyntax as rs

from studio2021.functions import make_grid
reload(make_grid)
from studio2021.functions.make_grid import trim_structure


columns, beams_x, beams_y, cores = trim_structure(polyline,
                                                  columns,
                                                  beams_x,
                                                  beams_y,
                                                  cores)
# ---------- end trim_grid ----------
trim_grid_2 = GhPythonScript(polyline=crv_2, columns=make_grid.columns, beams_x=make_grid.beams_x, beams_y=make_grid.beams_y, cores=make_grid.cores)  # -> out, columns, beams_x, beams_y, cores; inputs columns: list, beams_x: list, beams_y: list, cores: list; same code as trim_grid
columns = Curve(trim_grid.columns)
beams_x = Curve(trim_grid.beams_x)
beams_y = Curve(trim_grid.beams_y)
cores = Curve(trim_grid.cores)
columns_2 = Curve(trim_grid_2.columns)
beams_x_2 = Curve(trim_grid_2.beams_x)
beams_y_2 = Curve(trim_grid_2.beams_y)
cores_2 = Curve(trim_grid_2.cores)
panel_3 = Panel(trim_grid.out)
